# Grasshopper definition SpacePartition.gh (Grasshopper 1.0.7)
# plug-ins: FloorsAndVolumes, PTComponentLibrary

number_slider = Slider(9, range=0..10)
number_slider_2 = Slider(4, range=0..5)

# ---- group: NumberOfPoints
number_slider_3 = Slider(7, range=0..10)

# ----
dom = ConstructDomain(DomainStart=expr("-x", 0), DomainEnd=1)
dom_2 = ConstructDomain(DomainStart=expr("-x", number_slider), DomainEnd=number_slider)
dom_3 = ConstructDomain(DomainStart=expr("-x", number_slider_2), DomainEnd=number_slider_2)
genemodifier = GenePoolModifier(GeneList="SeedsX", Count=number_slider_3, Domain=dom)
genemodifier_2 = GenePoolModifier(GeneList="SeedsY", Count=number_slider_3, Domain=dom)
rectangle = Rectangle(Plane=PlaneXY(0, 0, 0), XSize=dom_3, YSize=dom_2, Radius=0)  # -> Rectangle, Length
seedsy = GenePool(Decimals=2, Maximum=1, Minimum=0, Value=[0.23, 0.63, 0.09990177308, 0.916884744, 0.8790581379, 0.59, 0.48])
seedsx = GenePool(
    Decimals=2,
    Maximum=1,
    Minimum=0,
    Value=[0.1172708991, 0.7884089145, 0.7228986177, 0.1277668779, 0.8053755317, 0.2773754938, 0.7481780559])
crv = Curve(rectangle.Rectangle)
number_slider_4 = Slider(22, range=0..100)
range = Range(Domain=dom_2, Steps=number_slider_4)
pt = ConstructPoint(XCoordinate=seedsx, YCoordinate=seedsy, ZCoordinate=0)
ptsrfdomlen = SurfaceDomainLength(Surface=crv, ULength=Slider(2, range=0..5), VLength=Slider(3, range=0..5))
evalsrf = EvaluateSurface(Surface=reparameterize(crv), Point=pt)  # -> Point, Normal, UDirection, VDirection, Frame
graph_mapper = GraphMapper(
    range,
    x0=0,
    x1=1,
    y0=0,
    y1=1,
    amplitude=0.9541024566,
    container_name="Perlin",
    decay=1,
    frequency=0.1424361169,
    x_offset=0.4676823318,
    y_offset=0.02912133932)  # disabled
construct_domain = ConstructDomain(DomainStart=Slider(0, range=0..100), DomainEnd=Slider(4, range=0..10))
pt_2 = Point(evalsrf.Point)
number_slider_5 = Slider(1.784, range=0..10)  # disabled
voronoi = Voronoi(Points=pt_2, Boundary=rectangle.Rectangle, BruteForceOverride=False)
multiplication = Multiplication(A=graph_mapper, B=number_slider_5)  # disabled
genepoolmodifier = GenePoolModifier(GeneList="Weights", Count=expr("x+1", number_slider_4), Domain=construct_domain)
surface = Surface(graft(voronoi))
number_slider_6 = Slider(13.910642, range=0..100)
knot_vector = KnotVector(Count=expr("x+1", number_slider_4), Degree=Slider(2, range=0..10), Periodic=False)
weights = GenePool(Decimals=2, Maximum=4, Minimum=0, Value=[2, 2, 2, 2, 2, 2, 2, 2, 2, 2, 2, 2, 2, 2, 2, 2, 2, 2, 2, 2, 2, 2, 2])
perlinnoise = CSharpScript(
    x=range,
    fre=Slider(7, range=0..10),
    amp=Slider(0.085056, range=0..1),
    iter=Slider(4, range=0..10),
    t=Slider(0.586953, range=0..1))  # -> out, A; inputs x: Double, fre: Double, amp: Double, iter: Int32, t: Double
# ---------- perlinnoise: C# ----------
    A = fbm(new vec3(x, 0, 0) + t, fre, amp, iter);
# ---------- perlinnoise: C# additional code ----------
  double hash(double a)
  {

    return fract(Math.Sin(a) * 4513.15);

  }

  double noise(vec3 x)
  {

    vec3 p = x.floor();
    vec3 k = x.fract();

    k *= k * k * ( 3.0 - 2.0 * k );

    double n = p.X() + p.Y() * 57.0 + p.Z() * 113.0;

    double a = hash(n);
    double b = hash(n + 1.0);
    double c = hash(n + 57.0);
    double d = hash(n + 58.0);

    double e = hash(n + 113.0);
    double f = hash(n + 114.0);
    double g = hash(n + 170.0);
    double h = hash(n + 171.0);

    double res = vec3.mix(vec3.mix(vec3.mix(a, b, k.X()), vec3.mix(c, d, k.X()), k.Y()),
      vec3.mix(vec3.mix(e, f, k.X()), vec3.mix(g, h, k.X()), k.Y()),
      k.Z()
      );

    return res;

  }

  double fbm(vec3 f, double freq, double ampl, int iter)
  {

    double amp = 1.0, fre = 1.7, res = 0.0;

    for( int i = 0; i < iter; ++i )
    {

      amp *= ampl;
      fre *= freq;

      amp += amp;

      res += amp * noise(fre * f);

    }

    return res;

  }

  class vec3
  {

    double x, y, z;

    public vec3(double x, double y, double z)
    {

      this.x = x;
      this.y = y;
      this.z = z;

    }

    public vec3(Point3d point)
    {

      this.x = point.X;
      this.y = point.Y;
      this.z = point.Z;

    }

    public double X()
    {

      return x;

    }

    public double Y()
    {

      return y;

    }

    public double Z()
    {

      return z;

    }

    // Addition operator overload.
    public static vec3 operator+( vec3 x, vec3 y )
    {

      return new vec3(x.X() + y.X(), x.Y() + y.Y(), x.Z() + y.Z());

    }

    public static vec3 operator+( vec3 x, double y )
    {

      return new vec3(x.X() + y, x.Y() + y, x.Z() + y);

    }

    public static vec3 operator+( double y, vec3 x )
    {

      return new vec3(y + x.X(), y + x.Y(), y + x.Z());

    }

    // Subtraction operator overload.
    public static vec3 operator-( vec3 x, vec3 y )
    {

      return new vec3(x.X() - y.X(), x.Y() - y.Y(), x.Z() - y.Z());

    }

    public static vec3 operator-( vec3 x, double y )
    {

      return new vec3(x.X() - y, x.Y() - y, x.Z() - y);

    }

    public static vec3 operator-( double y, vec3 x )
    {

      return new vec3(y - x.X(), y - x.Y(), y - x.Z());

    }

    // Multiplication operator overload.
    public static vec3 operator*( vec3 x, vec3 y )
    {

      return new vec3(x.X() * y.X(), x.Y() * y.Y(), x.Z() * y.Z());

    }

    public static vec3 operator*( vec3 x, double y )
    {

      return new vec3(x.X() * y, x.Y() * y, x.Z() * y);

    }

    public static vec3 operator*( double y, vec3 x )
    {

      return new vec3(y * x.X(), y * x.Y(), y * x.Z());

    }

    // Fractional part of a vec3.
    public vec3 fract()
    {

      return new vec3(fract(x), fract(y), fract(y));

    }

    // Floor.
    public vec3 floor()
    {

      return new vec3(Math.Floor(x), Math.Floor(y), Math.Floor(z));

    }

    // Fractional part of a double.
    public double fract(double x)
    {

      return x - Math.Truncate(x);

    }

    // Linear interpolation of a double.
    public static double mix(double a, double b, double c)
    {

      return a - ( 1 - c ) + b * c;

    }

    // Linear interpolation of a vec3.
    public static vec3 mix(vec3 a, vec3 b, double c)
    {

      double mixX = mix(a.X(), b.X(), c);
      double mixY = mix(a.Y(), b.Y(), c);
      double mixZ = mix(a.Z(), b.Y(), c);

      return new vec3(mixX, mixY, mixZ);

    }

    public Point3d toPoint()
    {

      return new Point3d(this.X(), this.Y(), this.Z());

    }

  }

  public double fract(double x)
  {

    return x - Math.Truncate(x);

  }
# ---------- end perlinnoise ----------
construct_point = ConstructPoint(XCoordinate=perlinnoise.A, YCoordinate=range, ZCoordinate=0)
nurbs_curve_pwk = NurbsCurvePWK(Points=construct_point, Weights=weights, Knots=knot_vector)  # -> Curve, Length, Domain
curve_attraction = CurveAttraction(Grid=ptsrfdomlen, CrvAtts=nurbs_curve_pwk.Curve, Magnitude=Slider(0.548, range=0..1))  # -> Grid, Weights
ptborders = GenerateBorders(Grid=curve_attraction.Grid, PanelShape=0)  # -> simplify(Border)
crv_2 = Curve(flatten(ptborders))
area = Area(Geometry=crv_2, UseTasks=False)  # -> Area, Centroid
colour_rgb = ColourRGB(Alpha=255, Red=Slider(0, range=0..1000), Green=Slider(0, range=0..1000), Blue=Slider(255, range=0..1000))
sort_list = SortList(Keys=area.Area, ValuesA=area.Area)  # -> Keys, ValuesA
custom_preview = CustomPreview(Geometry=nurbs_curve_pwk.Curve, Material=colour_rgb)
number_slider_7 = Slider(0, range=0..50)
list_length = ListLength(List=sort_list.ValuesA)
subtraction = Subtraction(A=list_length, B=1)
list_item = ListItem(List=sort_list.ValuesA, Index=subtraction, Wrap=True)
multiplication_2 = Multiplication(A=list_item, B=Slider(0.5, range=0..1))
c_script = CSharpScript(voronoiIn=voronoi, gridIn=crv_2, areaIn=multiplication_2, seed=Slider(4530, range=0..10000))  # -> culledGrid, R, G, B; inputs voronoiIn: list of Polyline, gridIn: list of Polyline, areaIn: Double, seed: Int32
# ---------- c_script: C# usings ----------
using System.Linq;
# ---------- c_script: C# ----------
    var intersections = new DataTree<Curve>();
    var repeated = new DataTree<Polyline>();
    var bools = new DataTree<bool>();

    for( int i = 0; i < voronoiIn.Count; ++i )
    {

      repeated.AddRange(gridIn, new GH_Path(i));

      for( int j = 0; j < gridIn.Count; ++j )
      {

        intersections.AddRange(Curve.CreateBooleanIntersection(voronoiIn[i].ToNurbsCurve(), gridIn[j].ToNurbsCurve(), 1e-7).ToList(), new GH_Path(i, j));

      }

    }

    for( int i = 0; i < intersections.BranchCount; ++i )
    {

      var tempList = intersections.Branch(i);
      var path = new GH_Path(intersections.Path(i).Indices[0]);
      bool temp = false;

      if( tempList.Count > 0 )
      {

        temp = AreaMassProperties.Compute(intersections.Branch(i)[0]).Area < areaIn ? false : true;

        bools.Add(temp, path);

      }

      else
      {

        temp = false;
        bools.Add(temp, path);

      }

    }

    var treeOut = new DataTree<Polyline>();
    var coloursOutR = new DataTree<int>();
    var coloursOutG = new DataTree<int>();
    var coloursOutB = new DataTree<int>();
    var rand = new Random(seed);

    for( int i = 0; i < bools.BranchCount; ++i )
    {

      var path = repeated.Path(i);

      coloursOutR.Add(rand.Next(0, 255), path);
      coloursOutG.Add(rand.Next(0, 255), path);
      coloursOutB.Add(rand.Next(0, 255), path);

      for( int j = 0; j < bools.Branch(i).Count; ++j )
      {

        if( bools.Branch(i)[j] == true )
        {

          treeOut.Add(repeated.Branch(i)[j], path);

        }

      }

    }

    culledGrid = treeOut;
    R = coloursOutR;
    G = coloursOutG;
    B = coloursOutB;
# ---------- end c_script ----------
panel = Panel(c_script.culledGrid)
colour_rgb_2 = ColourRGB(Alpha=Slider(51, range=0..255), Red=c_script.R, Green=c_script.G, Blue=c_script.B)
surface_2 = Surface(c_script.culledGrid)
colour_rgb_3 = ColourRGB(Alpha=Slider(255, range=0..1000), Red=c_script.R, Green=c_script.G, Blue=c_script.B)
custom_preview_2 = CustomPreview(Geometry=surface, Material=colour_rgb_2)
flatten_tree = FlattenTree(Tree=surface_2, Path="{0}")  # disabled
custom_preview_3 = CustomPreview(Geometry=surface_2, Material=colour_rgb_3)
list_length_2 = ListLength(List=flatten_tree)  # disabled
list_length_3 = ListLength(List=crv_2)  # disabled
expression = Expression(x=list_length_3, y=list_length_2, Expression="If( x ≠ y, False, True )")  # disabled
panel_2 = Panel(expression)  # disabled
